# Grasshopper definition anteaterTest.gh (Grasshopper 1.0.8)
# plug-ins: Karamba3D, LilyPad

panel = Panel("0.1")
brep = Brep(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)

# ----
# Choose refinement
panel_2 = Panel("50")

edges = BrepEdges(Brep=brep)  # -> Naked, Interior, NonManifold
triremesh = TriRemesh(Geometry=brep, Length="0.075", Iterations=25)  # -> Triangulation, Dual, Creases

# ----
# Structure: Square Slab Under UDL
# Analysis Input: Karamba 3D
# Field Generation Method: Displacement Field Method - Standard Order
# Step 1: Create Input Mesh
panel_3 = Panel("-5 to 5")
rectangle = Rectangle(Plane=PlaneXY(0, 0, 0), XSize=panel_3, YSize=panel_3, Radius=0)  # -> Rectangle, Length
mplane = MeshPlane(Boundary=rectangle.Rectangle, WidthCount=panel_2, HeightCount=panel_2)  # -> Mesh, Area
tri = Triangulate(Mesh=mplane.Mesh)  # -> Mesh, Count

item = ListItem(List=edges.Naked, Index=-1, Wrap=True)
crv = Curve(item)
mesh = Mesh(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)
demesh = DeconstructMesh(Mesh=mesh)  # -> Vertices, Faces, Colours, Normals
pull = PullPoint(Point=demesh.Vertices, Geometry=crv, ClosestOnly=True)  # -> ClosestPoint, Distance, Index
smaller = SmallerThan(FirstNumber=pull.Distance, SecondNumber="0.05")  # -> SmallerThan, OrEqualTo
cull = CullPattern(List=demesh.Vertices, CullPattern=smaller.SmallerThan)
supp = SupportKaramba3D(PosInd=cull, Ct_kN_m=Vector(0, 0, 0), Cr_kNm_rad=Vector(0, 0, 0), menu=[buttons(on, on, on, off, off, off)])
preview = CustomPreview(Geometry=mesh, Material=ColourSwatch(SwatchColor=RGB(97, 97, 97)))
explode = Explode(Curve=rectangle.Rectangle, Recursive=True)  # -> Segments, Vertices
cull_i = CullIndex(List=explode.Vertices, Indices=-1, Wrap=True)

# ---- group: Step 2:Create Nodal Translation For Mesh Node
# Step 2.0: Create Deformation Results
# we're using karamba to generate the deformation results in this case
matselect = MaterialSelectionKaramba3D(menu=[dropdown(1), dropdown(0)])
Z = UnitZ(Factor="-1")
crosec = CrossSectionKaramba3D(FamilyNameOfCrossSection="DefaultCroSec", NameOfCrossSection=matselect, Height_cm="1", mode="Shell - Const")
loads = LoadsKaramba3D(Vector=Z, Mesh=mesh, LCase="LC0", mode="MeshLoad -Const.", menu=[buttons(off, on, off), buttons(on, on)])
supp_2 = SupportKaramba3D(PosInd=cull_i, Ct_kN_m=Vector(0, 0, 0), Cr_kNm_rad=Vector(0, 0, 0), menu=[buttons(on, on, on, off, off, on)])
surfelem = CreateSurfaceElementKaramba3D(Mesh=mesh, CrossSection=crosec, LimitDistance_m=0.005, Bending=True, mode="MeshToShell")  # -> Element, Points, Info
assemble = AssembleModelKaramba3D(Elem=surfelem.Element, Support=supp, Load=loads, LimitDistance_m=0.005)  # -> Model, Info, Mass_kg, CentreOfGravity, LoadCaseNames
license = LicenseKaramba3D()
panel_4 = Panel(license)
analyse = AnalyseKaramba3D(Model=assemble.Model)  # -> AnalysedModel, MaximumDisplacement_cm, ResultingForce_kN, ChangeOfElasticEnergy_kNm
modelview = ModelViewKaramba3D(Model=analyse.AnalysedModel)  # -> Model, DeformedMesh, DeformedAxes, DeformedModel, MaximumDeformation
demesh_2 = DeconstructMesh(Mesh=mesh)  # -> Vertices, Faces, Colours, Normals
shellview = ShellViewKaramba3D(Model=modelview.Model, IndexOfLayer=0)  # -> Model, MeshesOfRenderedShells, LegendColours, LegendTags
nodedisp = NodalDisplacementsKaramba3D(AnalysedModel=analyse.AnalysedModel, PositionsIndexes=demesh_2.Vertices)  # -> Model, flatten(NodalTranslations_m), flatten(NodalRotations_rad), DisplacementPosition, LoadCaseIndex
legend = Legend(Colour=shellview.LegendColours, Tags=shellview.LegendTags, LegendType=1)

# ---- group: Vector Field
# connect the deformation results if they are avaliable
displacements = Data([Vector(0, 0, 0), Vector(0, 0, 0), Vector(0, 0, 0), Vector(0, 0, 0), Vector(0, 0, 0), Vector(0, 0, 0)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])
rotations = Data([Vector(7.628196915e-05, 3.375871973e-05, -7.925732253e-05), Vector(5.403714251e-05, -4.325213552e-05, 4.975849496e-05), Vector(1.165427122e-05, -1.199916101e-05, 0.0002088009237), Vector(-6.183101614e-06, -4.398962353e-08, 0.0002768716264), Vector(-1.35255752e-05, 4.81832152e-06, 0.0003052441207), Vector(-1.57247931e-05, 7.639631464e-06, 0.000313157234)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])

# ----
# Step 3: Create Principle Mesh
list = ValueList({"Bending Stress Lines": True, "In-Plane Stress Lines": False}, selected="Bending Stress Lines")
poisson_s_ratio = Panel("0.3")
defmesh = CreateDeformationMesh(Mesh=mesh, Translations=displacements, Rotations=rotations, PoissonsRatio=poisson_s_ratio, BendingStressLines=list)  # -> PrincipalDirection1, PrincipalDirection2

md_slider = MDSlider(SliderMode=0, slider_value=Point(0.5, 0.5, 0.5), x_domain=Domain(0, 1), y_domain=Domain(0, 1), z_domain=Domain(0, 1))
popgeo = PopulateGeometry(Geometry=mesh, Count=1, Seed=1)

# ---- group: Step 4: Selecting Seed Point
# Step 4: Create a Seed Point
# This can be any point on the mesh
medges = MeshEdges(Mesh=mesh)  # -> NakedEdges, InteriorEdges, NonManifoldEdges
md_slider_2 = MDSlider(SliderMode=0, slider_value=Point(0.5, 0.5, 0.5), x_domain=Domain(0, 1), y_domain=Domain(0, 1), z_domain=Domain(0, 1))
join = JoinCurves(Curves=medges.NakedEdges, Preserve=False)
boundary = BoundarySurfaces(Edges=join)
srf = Surface(boundary)
evalsrf = EvaluateSurface(Surface=reparameterize(srf), Point=md_slider_2)  # -> Point, Normal, UDirection, VDirection, Frame
meshcp = MeshClosestPoint(Point=evalsrf.Point, Mesh=mesh)  # -> Point, Index, Parameter
# Enable relays to run
# This may take a couple of minutes
dots = DotDisplay(Point=popgeo, Colour=RGB(0, 0, 0), Size=0.1)

# ----
evalsrf_2 = EvaluateSurface(Surface=reparameterize(srf), Point=md_slider)  # -> Point, Normal, UDirection, VDirection, Frame

# ----
# Step 5.2: Produce Stress lines through a seeding
number_slider = Slider(-4, range=-10..0)
number_slider_2 = Slider(0.1, range=0.05..1)
number_slider_3 = Slider(0.3, range=0..10)
number_slider_4 = Slider(0.08, range=0..0.1)
_10º = PowerOf10(Value=number_slider)
sls = StressLines(
    PrincipalMesh=defmesh.PrincipalDirection2,
    Seed=popgeo,
    StepTolerance=number_slider_2,
    MaxError=_10º,
    Seperation=number_slider_3,
    TestDist=number_slider_4)
sls_2 = StressLines(
    PrincipalMesh=defmesh.PrincipalDirection1,
    Seed=popgeo,
    StepTolerance=number_slider_2,
    MaxError=_10º,
    Seperation=number_slider_3,
    TestDist=number_slider_4)  # disabled
preview_2 = CustomPreview(Geometry=sls, Material=ColourSwatch(SwatchColor=RGB(255, 143, 212)))
preview_3 = CustomPreview(Geometry=sls_2, Material=ColourSwatch(SwatchColor=RGB(82, 184, 59)))

# ----
# Step 5.1: Produce Stress lines one at a time
number_slider_5 = Slider(-4, range=-10..0)
_10º_2 = PowerOf10(Value=number_slider_5)
stress_line = StressLine(PrincipalMesh=defmesh.PrincipalDirection1, Seed=popgeo, StepTolerance="0.1", MaxError=_10º_2)
stress_line_2 = StressLine(PrincipalMesh=defmesh.PrincipalDirection2, Seed=popgeo, StepTolerance="0.1", MaxError=_10º_2)
preview_4 = CustomPreview(
    Geometry=stress_line_2,
    Material={diffuse=RGB(13, 201, 0), emission=RGB(4, 60, 0), shine=0.5, specular=RGB(255, 255, 255), transparency=0})
preview_5 = CustomPreview(
    Geometry=stress_line,
    Material={diffuse=RGB(13, 201, 0), emission=RGB(4, 60, 0), shine=0.5, specular=RGB(255, 255, 255), transparency=0})

# ----
# Step 5.0: Check Principle Directions
popgeo_2 = PopulateGeometry(Geometry=mesh, Count=100, Seed=1)
# Results
eval = EvaluatePrincipalMesh(Principal=defmesh.PrincipalDirection1, Location=popgeo_2)
eval_2 = EvaluatePrincipalMesh(Principal=defmesh.PrincipalDirection2, Location=popgeo_2)
vdisex = VectorDisplayEx(Point=popgeo_2, Vector=expr("x/10", eval), Colour=RGB(255, 143, 212), Width=2)
vdisex_2 = VectorDisplayEx(Point=popgeo_2, Vector=expr("x/10", eval_2), Colour=RGB(82, 184, 59), Width=2)

midpt = CurveMiddle(Curve=sls)
points = PointList(Points=midpt)
item_2 = ListItem(List=sls, Index="6", Wrap=True)
explode_2 = Explode(Curve=item_2, Recursive=True)  # -> Segments, Vertices
end = EndPoints(Curve=explode_2.Segments)  # -> Start, End
facen = FaceNormals(Mesh=mesh)  # -> Centers, Normals
meshcp_2 = MeshClosestPoint(Point=end.End, Mesh=mesh)  # -> Point, Index, Parameter
item_3 = ListItem(List=facen.Normals, Index=meshcp_2.Index, Wrap=True)
pl = PlaneNormal(Origin=end.End, ZAxis=item_3)
rotate = Rotate(Geometry=explode_2.Segments, Angle="Pi/2", Plane=pl)  # -> Geometry, Transform
unit = UnitVector(Vector=rotate.Geometry)
multiplication = Multiplication(A=number_slider_3, B=unit)
move = Move(Geometry=end.End, Motion=expr("-x", multiplication))  # -> Geometry, Transform
move_2 = Move(Geometry=end.End, Motion=multiplication)  # -> Geometry, Transform
meshcp_3 = MeshClosestPoint(Point=move_2.Geometry, Mesh=mesh)  # -> Point, Index, Parameter
meshcp_4 = MeshClosestPoint(Point=move.Geometry, Mesh=mesh)  # -> Point, Index, Parameter
dist = Distance(PointA=meshcp_4.Point, PointB=end.End)
division = Division(A=number_slider_4, B=number_slider_3)
division_2 = Division(A=dist, B=number_slider_3)
larger = LargerThan(FirstNumber=division_2, SecondNumber="0.6")  # -> LargerThan, OrEqualTo
cull_2 = CullPattern(List=meshcp_4.Point, CullPattern=larger.LargerThan)
panel_5 = Panel(larger.LargerThan)
